# Grasshopper definition CityTune.gh (Grasshopper 0.9.76)
# plug-ins: Python Interpreter

# ----
# Spectrogram Input
panel = Panel("C:\Arch\M_Arch\1\CAD_2\Project\Operation\test3.wav")
spec_in = Spectogram_Input(f_Path=panel, RunIt=Toggle(False))  # -> readMe, folder
# ---------- spec_in: Python ----------
"""
Use this component to create a data file in text form from an audio file.
This file will be used be the U_Gen component.
It will run an external Python script that uses Scipy and Numpy module bundles.
Make sure you have an external interpreter with the modules installed.
Make sure you place the Spectro.py script file in the same folder as the audio file.
-
Author: Eli Greenberg
-
    Args:
        f_Path: Enter the location of a .wav type audio file. This input is obligatory.
        RunIt: Run the component!
    Returns:
        readMe!: Generic text output.
        folder: A path to the working folder for the U_Gen component to use.
"""
ghenv.Component.Name     = 'Spectogram_Input'           # Define Component name
ghenv.Component.NickName = 'Spec_In'                    # Define Component nickname
ghenv.Component.Message  = 'VER 1.0.3\nFeb_27_2016'     # Define Component message (Version and date)

import os

if RunIt:                                               # Hey! Ho! Let's go!
    folder = f_Path.rsplit('\\', 1)[0]                  # find the folder to be used as the working folder.
    print 'Working folder is', folder
    Spec = os.path.join(folder,'Spectro.py')            # define the path to the external spectrogram script.
    
    if os.path.isfile(Spec):                            # check if the external script, Spectro.py, is present in the working folder.
    
        wav_in_file = os.path.join(folder, 'wav_in.txt')# create .txt file.
        wav_in = open(wav_in_file, 'w')
        wav_in.write(f_Path)                            # Write the path to the .txt file that will point the wav file for the external script to process.
        wav_in.close()
        
        Spec_launch = 'python '+Spec                    # create input string for os.system module to make sure it launches the script with the proper application.
        os.system(Spec_launch)                          # Launch Spectro.py! This script will produce a .txt file with values for the U_Gen component.       
        
        Data_file = os.path.join(folder,'spec_dat.txt') # define a path to the output of Spectro.py
        if os.path.isfile(Data_file):                   # see if spec_dat.txt is present so that U_Gen can run.
            print 'We are good to go! Launch U_Gen component!'
        else:
            print 'Error! Data file for U_Gen component not found!'
    else:
        print 'Please place Spectro.py script file in the same folder as the input audio file!'
# ---------- end spec_in ----------
panel_2 = Panel(spec_in.readMe)

# ----
# Urban Generator
panel_3 = Panel("100")
u_gen = Urban_Generator(RunIt=Toggle(False), par=Toggle(True), Density=panel_3, folder=spec_in.folder)  # -> readMe, Topo, Buildings; inputs Density: Int32
# ---------- u_gen: Python ----------
"""
Creates a city scape from the spectrogram output. Uses .txt files genrated by the Spec_In component.
-
Author: Eli Greenberg
-
    Args:
        RunIt: Run the component. There  is a good chance this will take quite a while. Execute with caution.
        par: Boolean. Set to true to run some of the processes in parallel to speed up performance.
        Density: The number of points in the topography for which a bilding will be built. 1 is the minimum value and will provide maximum density of buildings. It also will produce a building for every point and might be heavy to run.
        folder: A path to the operating folder. Provided by the Spec_In component.
    Returns:
        readMe!: Generic text output.
        Topo: A geometry of the topography for the city scape.
        Buildings: Geometry of the different city buildings.
"""

ghenv.Component.Name     = 'Urban_Generator'                    # Define Component name
ghenv.Component.NickName = 'U_Gen'                              # Define Component nickname
ghenv.Component.Message  = 'VER 0.0.3\nFeb_27_2016'             # Define Component message (Version and date)

# Import relevant libraries so the component can run properly
import ghpythonlib.components as ghpl
import ghpythonlib.parallel as pl
import math
import os

def normalize (number, min, max):                               # Define a primitive normalization fonction. 
    if number < min:                                            # To be used for the build method of the Bldg class to avoid useless values
        number = min                                            # Inputs are a number variable, and the minimum and maximum values allowed
    if number > max:
        number = max
    return number                                               # retun a number in the desired range
    
class Bldg:                                                     # define the Bldg class
    # define build method to create buildings.
    def build(self, point, base_sides = 4, roof_sides = 4, base_radius = 2, roof_radius = 2, height = 10, rotation = 0):
        
        global grd_spacing                                      # use grd_spacing variable as a global. Is used to limit the radius of buildings so that overlapping will not occur.
        self.rad_max = grd_spacing/2
        # make sure radius and height values are legit
        base_radius = normalize(base_radius, 2, self.rad_max)
        base_sides = normalize(base_sides, 2, 12)
        roof_radius = normalize(roof_radius, 2, self.rad_max)
        roof_sides = normalize(roof_sides, 2, 12)
        height = normalize(height, 2, 100)
        
        self.a = ghpl.ConstructPoint(0,0,0)                     # point a for vector
        self.b = ghpl.ConstructPoint(0,0,height)                # point b for vector
        self.disp = ghpl.Vector2Pt(self.a,self.b)               # create vector for plane definition
        self.bspt = ghpl.SurfaceClosestPoint(point, Topo)[0]    # find point on Topo surface for base of building
        self.plane = ghpl.PlaneNormal(self.bspt,self.disp)      # define plane for geometry creation
        self.rotation = rotation * math.pi/180                  # turn to radians
        
        if int(base_sides) < 3:                                 # create base shape
            self.base = ghpl.Circle(self.plane, base_radius) 
        elif int(base_sides) >= 3 :
            self.base = ghpl.Polygon(self.plane, base_radius, base_sides)[0]

        if int(roof_sides) < 3:                                 # create roof shape
            self.roof_shp = ghpl.Circle(self.plane, roof_radius)
            self.roof_rot = 0
        elif int(roof_sides) >= 3 :
            self.roof_shp = ghpl.Polygon(self.plane, roof_radius, roof_sides)
            self.roof_rot = ghpl.Rotate(self.roof_shp, self.rotation, self.plane)[0] # rotate roof by self.rotation

        if self.roof_rot:
            self.roof = ghpl.Move(self.roof_rot, self.disp)[0] # move roof to correct height
        else:
            self.roof = ghpl.Move(self.roof_shp, self.disp)[0] # move roof to correct height
            
        self.skin = ghpl.Loft([self.base, self.roof])          # loft building shape
        self.skin = ghpl.CapHolesEx(self.skin)[0]              # create base and roof for building
        return self.skin
        
    """
    def render(skin, material)                                 # optional future function
    """
# a function to populate attribute lists and evaluate the strings that comprise them for later use in producing topography and buildings
def poptrim(attrib): 
    lst = attrib[0]                                            # list
    step = attrib[1]                                           # step
    grd_sz = attrib[2]                                         # maximum size of list
    offset = attrib[3]                                         # offset of first value
    
    tmp_attr = list(lst[offset:(grd_sz*(step-1)):(step-1)])    # create a temporary attribute list 
    
    attr = map(eval,tmp_attr)                                  # evaluate all strings
    
    return attr
    
def buildall (input_data):                                     # function for parallel building construction
    
    house = Bldg()                                             # define an instance of Bldg and build it
    bld = house.build(input_data[0], input_data[1], input_data[2], input_data[3], input_data[4], input_data[5], input_data[6])
    
    return bld
    
if RunIt:                                                      # Hey! Ho! Let's go!
    # determine dimensions of grid
    spec_dim_file = os.path.join(folder, 'spec_dim.txt')       # define path from working folder. Use input from Spec_In component.
    spec_dim = open(spec_dim_file, 'r') 
    tdim = spec_dim.read()
    spec_dim.close()
    xydims = tdim.split(',')                                   # obtain value list
    # turn them from strings to integers
    xdim = eval(xydims[0])
    ydim = eval(xydims[1])
    # normalize dimensions to a manageable ratio, avoid very elongated grids
    if (xdim / ydim) > 4: 
        dim_rel = xdim // ydim
        xdim_f = int(xdim/dim_rel)
        ydim_f = ydim
    elif (ydim / xdim) > 4:
        dim_rel = ydim // xdim
        ydim_f = int(ydim/dim_rel)
        xdim_f = xdim
    else:
        xdim_f = xdim
        ydim_f = ydim
        if xdim - ydim >= 0:                                   # dim_rel will be used for the step in determining the atrribute lists for the Bldg class
            dim_rel = xdim // ydim                             #  - so a managable value must be ensured.
            if dim_rel < 2:
                dim_rel = 2
        elif ydim - xdim>= 0:
            dim_rel = ydim // xdim
            if dim_rel < 2:
                dim_rel = 2
        else:
            dim_rel = 2
    print 'Grid dimensions are', xdim_f, 'X' ,ydim_f,'.'       # routine check of values

    # get data for Bldg class attributes
    spec_dat_file = os.path.join(folder, 'spec_dat.txt')       # define path from working folder again
    freq_file = open(spec_dat_file, 'r')
    freq_text = freq_file.read()
    freq_file.close()
    freqs = freq_text.split(',')                               # obtain value list
    print 'Initial number of values is',len(freqs)             # routine check of values

    # create a set of lists of attributes for Bldg class
    attrib = []                                                # input list for poptrim function to run in parallel
    grd_sz = xdim_f * ydim_f                                   # calculate grid size (number of points in it)
    for i in range(7):                                         # create list to be used as input for parallel computing
        tmplist = [freqs, dim_rel, grd_sz, i]
        attrib.append(tmplist)
        
    # populate and evaluate 7 attribute lists for the Bldg class and for Topo in parallel
    if par:
        outlists = pl.run(poptrim, attrib, False)              # run in parallel
    else:
        outlists = map(poptrim, attrib)                        # run linear
        
    for i in range(len(outlists)):
        print 'The length of the', i+1 , 'attribute list is', len(outlists[i]),'.' # routine check of values
    
    #create point grid.
    grd_pts = []                                        # list of points in the grid
    z = outlists.pop()                                  # list to be used as z values for the points
    k=0                                                 # iterator fo z
    if Density > grd_sz:                                # make sure Density doesn't escape possible range.
        Density = grd_sz
    grd_spacing = int(10-9/grd_sz*Density)              # determine a grid spacing relative to both Density and grd_sz create landscapes of relative integrity
    for i in range(0, xdim_f*grd_spacing, grd_spacing): # create spacing between points the size of grd_spacing
        for j in range(0, ydim_f*grd_spacing, grd_spacing):
            tmp = z[k]/1.5                              # avoid topography that is too steep
            grd_pts.append(ghpl.ConstructPoint(i,j,tmp))
            k = k+1
    print 'Number of points is', len(grd_pts),'.'       # routine check of values

    Topo = ghpl.SurfaceFromPoints(grd_pts, xdim_f)      # create topography from grd_pts list

    

    bld_params = []                                     # list to be used as input for the parallel running buildall function
    
    for i in range(0, grd_sz, Density):                 # populate the lists of parameters to be used for each building
        tmp_params = []                                 # a new empty list for parameters of a single building
        tmp_params.append(grd_pts[i])
        tmp_params.append(outlists[0][i])
        tmp_params.append(outlists[1][i])
        tmp_params.append(outlists[2][i])
        tmp_params.append(outlists[3][i])
        tmp_params.append(outlists[4][i])
        tmp_params.append(outlists[5][i])
        bld_params.append(tmp_params)                   # append the general list for all buildings

    print 'Length of bld_params is', len(bld_params)    # routine check of values
    
    # build all instances of Bldg upon the topography Topo, in parallel or one by one.
    if par:
        Buildings = pl.run(buildall, bld_params, True)  # run in parallel
    else:
        Buildings = map(buildall, bld_params)           # run in linear
# ---------- end u_gen ----------
panel_4 = Panel(u_gen.readMe)
